# Grasshopper definition Hypar.gh (Grasshopper 1.0.8)

distance_between_the_points = Slider(5, range=0..100)
number_of_points = Slider(79, range=0..100)
distance_on_y_axis = Slider(47, range=0..100)
initial_coords = Slider(0, range=0..10)
multiplication = Multiplication(A=distance_on_y_axis, B=Slider(4, range=0..100))
number_slider = Slider(56, range=0..100)
range = Range(Domain=Slider(1, range=0..1), Steps=number_of_points)
X = UnitX(Factor=distance_between_the_points)
pt = ConstructPoint(XCoordinate=initial_coords, YCoordinate=initial_coords, ZCoordinate=initial_coords)
graph = GraphMapper(reverse(range), x0=0, x1=1, y0=0, y1=1, container_name="Gaussian", factor=0.2, mean=0.48396191, sdev=0.1846508086)
graph_2 = GraphMapper(range, x0=0, x1=1, y0=0, y1=1, container_name="Sine", Equation_px=[0, 0.3755463958], Equation_py=[0.2772044539, 1])
graph_3 = GraphMapper(
    range,
    x0=0,
    x1=1,
    y0=0,
    y1=1,
    container_name="Sine",
    Equation_px=[0.01159446873, 0.2001112849],
    Equation_py=[0.3797098994, 1])
arrlinear = LinearArray(Geometry=pt, Direction=X, Count=number_of_points)  # -> Geometry, Transform
Y = UnitY(Factor=distance_on_y_axis)
Y_2 = UnitY(Factor=multiplication)
Z = UnitZ(Factor=graph_2)
Z_2 = UnitZ(Factor=graph_3)
Z_3 = UnitZ(Factor=graph)
multiplication_2 = Multiplication(A=Z, B=number_slider)
multiplication_3 = Multiplication(A=Z_2, B=number_slider)
multiplication_4 = Multiplication(A=Z_3, B=number_slider)
move = Move(Geometry=arrlinear.Geometry, Motion=multiplication_3)  # -> Geometry, Transform
move_2 = Move(Geometry=arrlinear.Geometry, Motion=multiplication_4)  # -> Geometry, Transform
move_3 = Move(Geometry=arrlinear.Geometry, Motion=multiplication_2)  # -> graft(Geometry), Transform
move_4 = Move(Geometry=move.Geometry, Motion=Y)  # -> graft(Geometry), Transform
move_5 = Move(Geometry=move.Geometry, Motion=Y_2)  # -> graft(Geometry), Transform
intcrv = Interpolate(Vertices=[move_3.Geometry, move_4.Geometry, move_5.Geometry], Degree=3, Periodic=False, KnotStyle=1)  # -> Curve, Length, Domain
project = Project(Geometry=intcrv.Curve, Plane=PlaneXY(0, 0, 0))  # -> Geometry, Transform
loft = Loft(
    Curves=[intcrv.Curve, project.Geometry],
    Options={Adjust=False, Closed=False, LoftEnds=0, LoftSimp=0, LoftType=0, Rebuild=10, Refit=0.01})
loft_2 = Loft(
    Curves=flatten(intcrv.Curve),
    Options={Adjust=False, Closed=False, LoftEnds=0, LoftSimp=0, LoftType=0, Rebuild=10, Refit=0.01})
Z_4 = UnitZ(Factor=Slider(-2, range=-100..100))
move_6 = Move(Geometry=loft_2, Motion=Z_4)  # -> Geometry, Transform
intcrv_2 = Interpolate(Vertices=flatten(move_3.Geometry), Degree=3, Periodic=False, KnotStyle=1)  # -> Curve, Length, Domain
intcrv_3 = Interpolate(Vertices=flatten(move_5.Geometry), Degree=3, Periodic=False, KnotStyle=1)  # -> Curve, Length, Domain
intcrv_4 = Interpolate(Vertices=flatten(move_4.Geometry), Degree=3, Periodic=False, KnotStyle=1)  # -> Curve, Length, Domain
pipe = Pipe(Curve=intcrv.Curve, Radius=Slider(1.5, range=0..2), Caps=0)
pipe_2 = Pipe(Curve=[intcrv_2.Curve, intcrv_4.Curve, intcrv_3.Curve], Radius=Slider(2.2, range=0..5), Caps=0)
