# Grasshopper definition Louvers.gh (Grasshopper 1.0.8)

pt = ConstructPoint(XCoordinate=Slider(7, range=0..10), YCoordinate=Slider(10, range=0..10), ZCoordinate=Slider(0, range=0..10))
pt_2 = ConstructPoint(XCoordinate=Slider(0, range=0..10), YCoordinate=Slider(3, range=0..10), ZCoordinate=Slider(0, range=0..10))
Z = UnitZ(Factor=Slider(10, range=0..10))
ln = Line(StartPoint=pt, EndPoint=pt_2)
move = Move(Geometry=ln, Motion=Z)  # -> Geometry, Transform

# ---- group: Getting a vector perpendicular to the plane
lnpt = LinePt(Line=move.Geometry, Point=pt)
deplane = DeconstructPlane(Plane=lnpt)  # -> Origin, XAxis, YAxis, ZAxis

# ----
divide = DivideCurve(Curve=ln, Count=10, Kinks=False)  # -> Points, Tangents, Parameters
divide_2 = DivideCurve(Curve=move.Geometry, Count=10, Kinks=False)  # -> Points, Tangents, Parameters
length_of_the_louvers = Slider(3, range=0..10)
thickness_of_the_louvers = Slider(0.25, range=0..10)
ln_2 = Line(StartPoint=divide.Points, EndPoint=divide_2.Points)
multiplication = Multiplication(A=deplane.ZAxis, B=length_of_the_louvers)
# Making the louvers two-dimensional
extr = Extrude(Base=ln_2, Direction=multiplication)
# Get another axis of
# our orthogonal plane
multiplication_2 = Multiplication(A=deplane.XAxis, B=thickness_of_the_louvers)
# Making the louvers
# three-dimensional
extr_2 = Extrude(Base=extr, Direction=multiplication_2)
multiplication_3 = Multiplication(A=multiplication, B=Slider(-0.5, range=-10..1))
dom = ConstructDomain(DomainStart=Slider(-1, range=-1..1), DomainEnd=Slider(1, range=0..1))
range = Range(Domain=dom, Steps=10)
# Move to the center of the construction
# Base line points
# are the base of rotation
move_2 = Move(Geometry=extr_2, Motion=multiplication_3)  # -> Geometry, Transform
multiplication_4 = Multiplication(A=Slider(46, range=0..360), B=range)
rad = Radians(Degrees=multiplication_4)
# Rotating the louvers
rotate = Rotate(Geometry=move_2.Geometry, Angle=rad, Plane=ln_2)  # -> Geometry, Transform
