# Grasshopper definition Perforation.gh (Grasshopper 1.0.8)

number_slider = Slider(10, range=0..10)
thickness = Slider(0.25, range=0..1)
number_slider_2 = Slider(1, range=0..10)
pt = ConstructPoint(XCoordinate=Slider(0, range=0..10), YCoordinate=Slider(0, range=0..10), ZCoordinate=Slider(0, range=0..10))
Z = UnitZ(Factor=number_slider)
Y = UnitY(Factor=number_slider)
X = UnitX(Factor=thickness)
move = Move(Geometry=pt, Motion=Y)  # -> Geometry, Transform
# thickness
dom = ConstructDomain(DomainStart=number_slider_2, DomainEnd=number_slider)
number_slider_3 = Slider(10, range=0..10)
ln = Line(StartPoint=pt, EndPoint=move.Geometry)
subtraction = Subtraction(A=number_slider, B=number_slider_2)
move_2 = Move(Geometry=ln, Motion=Z)  # -> Geometry, Transform
lnpt = LinePt(Line=move_2.Geometry, Point=pt)
planesrf = PlaneSurface(Plane=lnpt, XSize=number_slider, YSize=number_slider)
divide = DivideCurve(Curve=ln, Count=number_slider_3, Kinks=False)  # -> Points, Tangents, Parameters

# ---- group: trimming perforations to be within the panel
dom_2 = ConstructDomain(DomainStart=Slider(1, range=0..1), DomainEnd=Slider(9, range=0..10))
subset = SubList(List=divide.Points, Domain=dom_2, Wrap=True)  # -> List, Index

# ---- group: making tubes (decorative)
divide_2 = DivideCurve(Curve=move_2.Geometry, Count=number_slider_3, Kinks=False)  # -> Points, Tangents, Parameters
ln_2 = Line(StartPoint=divide_2.Points, EndPoint=divide.Points)
pipe = Pipe(Curve=ln_2, Radius=Slider(0.043, range=0..1), Caps=Slider(1, range=0..1))

# ----
number_slider_4 = Slider(11, range=0..100)
dom_3 = ConstructDomain(DomainStart=Slider(0.1, range=0..0.1), DomainEnd=Slider(0.31, range=0..1))
# random values
multiplication = Multiplication(A=subtraction, B=subtraction)
random = Random(Range=dom_3, Number=multiplication, Seed=2)
partition = PartitionList(List=random, Size=subtraction)

# ----
# wall
extr = Extrude(Base=planesrf, Direction=X)
range = Range(Domain=dom, Steps=number_slider_3)
# same
number_slider_5 = Slider(0.25, range=0..1)
Z_2 = UnitZ(Factor=range)
# propagation
move_3 = Move(Geometry=graft(subset.List), Motion=Z_2)  # -> Geometry, Transform

# ----
# distance to the sphere
vec = VectorXYZ(XComponent=Slider(-3, range=-10..10), YComponent=Slider(7, range=0..10), ZComponent=Slider(4, range=0..10))  # -> Vector, Length
sph = Sphere(Base=PlaneXY(0, 0, 0), Radius=Slider(0.38, range=0..1))
# sphere of power
move_4 = Move(Geometry=sph, Motion=vec.Vector)  # -> Geometry, Transform
dist = Distance(PointA=move_3.Geometry, PointB=vec.Vector)

panel = Panel(partition)
# min and max distances
bnd = Bounds(Numbers=flatten(dist))
dedomain = DeconstructDomain(Domain=bnd)  # -> Start, End

# ----
# Our values were from 3 to 9, but we
# want them to be from 0 to 1, so that
# 3 becomes 0 and 9 becomes 1.
# This operation is called normalization
# and can be done in the following way:
# 
# (x - min(list)) / (max(list) - min(list))
subtraction_2 = Subtraction(A=dedomain.Start, B=dedomain.End)
subtraction_3 = Subtraction(A=dist, B=dedomain.End)
# normalization
division = Division(A=subtraction_3, B=subtraction_2)

multiplication_2 = Multiplication(A=division, B=Slider(0.4, range=0..1))
# make sure no circles
# have radius 0
addition = Addition(A=Slider(0.1, range=0..0.1), B=multiplication_2)
# >>> wall
# perforation
circle = CircleCNR(Center=move_3.Geometry, Normal=lnpt, Radius=addition)

# ---- group: circular panels in the middle of the holes
X_2 = UnitX(Factor=Slider(0.04, range=0..1))
offset = OffsetCurve(Curve=circle, Distance=Slider(-0.09, range=-1..1), Corners=1)
extr_2 = Extrude(Base=offset, Direction=X_2)
cap = CapHoles(Brep=extr_2)

# ----
X_3 = UnitX(Factor=Slider(3, range=0..10))
extr_3 = Extrude(Base=circle, Direction=X_3)
# perforation
# extrusion
X_4 = UnitX(Factor=Slider(-1.1, range=-2..1))
cap_2 = CapHoles(Brep=extr_3)
move_5 = Move(Geometry=cap_2, Motion=X_4)  # -> Geometry, Transform

# ---- group: circular panels' rotation
lng = ListLength(List=circle)
random_2 = Random(Range=Domain(0, 1), Number=lng, Seed=2)
multiplication_3 = Multiplication(A=Slider(360, range=0..360), B=random_2)
rad = Radians(Degrees=multiplication_3)

# ----
sdiff = SolidDifference(BrepsA=extr, BrepsB=flatten(move_5.Geometry))
rot3d = Rotate3D(Geometry=cap, Angle=graft(rad), Center=graft(move_3.Geometry), Axis=Vector(0, 0, 1))  # -> Geometry, Transform
